# Grasshopper definition 210310_ThermalBridging.gh (Grasshopper 1.0.7)

ladybug = Ladybug_Ladybug()  # -> Vviiiiiiiiiizzz; plug-in component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
honeybee = Honeybee_Honeybee()  # -> Vviiiiiiiiiizzz; plug-in component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

# ----
# Specify Spacing
# between the studs
number_slider = Slider(1.6, range=0..10)
number_slider_2 = Slider(0.7, range=0..10)

# ----
# Specify stud depth
# Specify stud width
# Specify stud material thickness
l = Slider(0.1, range=0..1)
a = Slider(0.03, range=0..1)

# ----
# Specify Appoximate
# facade dimensions
number_slider_3 = Slider(9.6, range=0..10)

# ----
# Insulation conductivity
# Stud conductivity
# W/mK
number_slider_4 = Slider(50, range=1..50)

cluster = Cluster(
    A_3=number_slider_2,
    B_3=number_slider,
    A_4=a,
    F=l,
    A=number_slider_3,
    B=number_slider_2,
    B_5=number_slider_2,
    A_2=Slider(3.2, range=0..10),
    B_2=number_slider,
    B_4=number_slider)  # -> R, C, R_2

# ----
# Profile R value
multiplication = Multiplication(A=number_slider_4, B=Slider(0.001, range=0..0.01))
multiplication_2 = Multiplication(A=l, B=a)
contact_resistance_of_metal_frame = Panel("0.03*2")  # disabled
division = Division(A=multiplication_2, B=multiplication)
addition = Addition(A=division, B=contact_resistance_of_metal_frame)  # disabled

# ----
# Insulation R value
division_2 = Division(A=l, B=Slider(0.04, range=0..1))

cluster_2 = Cluster_2(A=cluster.R_2, B_3=division, B=cluster.R_2, B_2=division_2)

# ----
# Insulatoion R value
# with acount for thermal bridging
panel = Panel(cluster_2)

epnomassmat = Honeybee_EnergyPlusNoMassOpaqueMaterial(name="InsulationWithStud", R_Value=cluster_2)  # -> EPMaterial; plug-in component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
panel_2 = Panel(epnomassmat)

# ==== cluster Cluster
A = ClusterInput()
B = ClusterInput()
A_2 = ClusterInput()
B_2 = ClusterInput()
A_3 = ClusterInput()
B_3 = ClusterInput()
B_4 = ClusterInput()
B_5 = ClusterInput()
F = ClusterInput()
A_4 = ClusterInput()
division = Division(A=A_2, B=B_2)
division_2 = Division(A=A, B=B)
int = Integer(division)
panel = Panel(int)
int_2 = Integer(division_2)
panel_2 = Panel(int_2)
yz = YZPlane(Origin=Point(0, 0, 0))
multiplication = Multiplication(A=int_2, B=B_5)
multiplication_2 = Multiplication(A=int, B=B_4)

# ----
# Wall
wallsurfaace = Rectangle(Plane=yz, XSize=multiplication, YSize=multiplication_2, Radius=0)  # -> Rectangle, Length

concat = Concatenate(FragmentD="0,", FragmentA=A_3, FragmentC=",", FragmentB=B_3)
division_3 = Division(A=A_4, B=2)
neg = Negative(Value=division_3)
rec_2pt = Rectangle2Pt(Plane=yz, PointA="0,0,0", PointB=concat, Radius=0)  # -> Rectangle, Length
R = ClusterOutput(rec_2pt.Rectangle)

# ----
# Stud Perimetre
offset = Offset(Curve=rec_2pt.Rectangle, Distance=neg, Plane=yz, Corners=1)

C = ClusterOutput(offset)
boundary = BoundarySurfaces(Edges=flatten([offset, rec_2pt.Rectangle]))
X = UnitX(Factor=F)
arrrec = RectangularArray(Geometry=boundary, Cell=rec_2pt.Rectangle, XCount=division_2, YCount=division)  # -> Geometry, Transform
extr = Extrude(Base=arrrec.Geometry, Direction=X)
area = Area(Geometry=flatten(arrrec.Geometry))  # -> Area, Centroid
boundary_2 = BoundarySurfaces(Edges=wallsurfaace.Rectangle)
area_2 = Area(Geometry=boundary_2)  # -> Area, Centroid
ma = MassAddition(Input=area.Area)  # -> Result, PartialResults
subtraction = Subtraction(A=area_2.Area, B=ma.Result)

# ----
# Studs area
panel_3 = Panel(ma.Result)

# ----
# Facade area
# without studs
panel_4 = Panel(subtraction)

division_4 = Division(A=ma.Result, B=area_2.Area)
R_2 = ClusterOutput(division_4)
multiplication_3 = Multiplication(A=division_4, B=100)

# ----
# % of studs to total
# facade area
panel_5 = Panel(multiplication_3)

# ==== cluster Cluster_2
B = ClusterInput()
B_2 = ClusterInput()
A = ClusterInput()
B_3 = ClusterInput()
subtraction = Subtraction(A=1, B=B)
division = Division(A=subtraction, B=B_2)
division_2 = Division(A=A, B=B_3)
addition = Addition(A=division_2, B=division)
division_3 = Division(A=1, B=addition)
R = ClusterOutput(division_3)
